# Grasshopper definition Speckle_Toolkit-runOnLocalServer.gh (Grasshopper 1.0.7)
# plug-ins: UserDataUtils, BH.UI.Grasshopper

# ----
# Elements to push
pop3d = Populate3D(Region={Plane=PlaneXY(0, 0, 0), X=Domain(0, 10), Y=Domain(0, 10), Z=Domain(0, 2)}, Count=100, Seed=1)
bbox = BoundingBox(Content=pop3d, Plane=PlaneXY(0, 0, 0), UnionBox=True)  # -> Box, Box_2
smesh = SimpleMesh(Brep=bbox.Box)
demesh = DeconstructMesh(Mesh=smesh)  # -> Vertices, Faces, Colours, Normals
mesh = Mesh(Vertices=demesh.Vertices, Faces=demesh.Faces, Component="{ .Mesh")

geo = Geometry(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)
line = Line(geo)
bar = Bar(
    Line=line,
    OrientationAngle=0,
    FeaType="{ \"_t\" : \"System.Enum\", \"TypeName\" : { \"_t\" : \"System.Type\", \"Name\" : \"BH.oM.Structure.Elements.BarFEAType\" }, \"Value\" : \"Flexural\" }",
    Component="{ .Bar")

ln = Line(StartPoint="0,0,0", EndPoint="10,10,10")

sph = Sphere(Base=PlaneXY(0, 0, 0), Radius=Slider(50, range=0..100))

bar_2 = Bar(
    Line=ln,
    OrientationAngle=0,
    FeaType="{ \"_t\" : \"System.Enum\", \"TypeName\" : { \"_t\" : \"System.Type\", \"Name\" : \"BH.oM.Structure.Elements.BarFEAType\" }, \"Value\" : \"Flexural\" }",
    Component="{ .Bar")
bar_3 = Bar(
    Line=line,
    OrientationAngle=0,
    FeaType="{ \"_t\" : \"System.Enum\", \"TypeName\" : { \"_t\" : \"System.Type\", \"Name\" : \"BH.oM.Structure.Elements.BarFEAType\" }, \"Value\" : \"Flexural\" }",
    Component="{ .Bar")
data = Data([bar, mesh, sph, bar_3, bar_2])

# ----
# Set up Speckle Adapter
anonymous_stream = DataSender(manualmode=False, remotecontroller=False)  # -> Log, StreamId
bh_speckle_server = Accounts()
speckleadapter = SpeckleAdapter(SpeckleAccount=bh_speckle_server, SpeckleStreamId=anonymous_stream.StreamId, Component="{ ..ctor")

# ----
# Enable/disable
# - history (enabled by default)
# - "diffing by GUID" (disabled by default)
createtype = CreateType(Component="System.Object")
createtype_2 = CreateType(Component="System.String")
createdictionary = CreateDictionary(
    Keys=["EnableHistory", "UseGUIDS"],
    Values=[Toggle(True), Toggle(False)],
    KeyType=createtype_2,
    ValueType=createtype,
    Component="{ .CreateDictionary")

# ----
# Push (upload)
toggle = BooleanToggle(True)
push = Push(Adapter=speckleadapter, Objects=flatten(data), Config=createdictionary, Active=toggle, Component="{ .Push")  # -> Objects, Success
panel = Panel(push.Objects)

item = ListItem(List=flatten(push.Objects), Index=0, Wrap=True)  # -> Item, Item1, Item2, Item3
explode = Explode(Object=item.Item, Component="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")  # -> StartNode, EndNode, SectionProperty, OrientationAngle, Release, FEAType, Support, Offset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

# ----
# Pull (download)
pull = Pull(Adapter=speckleadapter, Active=Toggle(True), Component="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")
panel_2 = Panel(pull)

explode_2 = Explode(Object=explode.CustomData, Component="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")  # -> Speckle_StreamId, Speckle_id
item_2 = ListItem(List=flatten(pull), Index=0, Wrap=True)  # -> Item, Item1, Item2, Item3
item_3 = ListItem(List=item_2.Item, Index=0, Wrap=True)
explode_3 = Explode(Object=item_3, Component="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")  # -> StartNode, EndNode, SectionProperty, OrientationAngle, Release, FEAType, Support, Offset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
explode_4 = Explode(Object=explode_3.CustomData, Component="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")
