# Grasshopper definition #34-SelectingCertainIDsgh-updatedForBreakingChanges.gh (Grasshopper 1.0.7)
# plug-ins: UserDataUtils, BH.UI.Grasshopper

# ----
# Elements to push
pop3d = Populate3D(Region={Plane=PlaneXY(0, 0, 0), X=Domain(0, 10), Y=Domain(0, 10), Z=Domain(0, 2)}, Count=100, Seed=1)
bbox = BoundingBox(Content=pop3d, Plane=PlaneXY(0, 0, 0), UnionBox=True)  # -> Box, Box_2
smesh = SimpleMesh(Brep=bbox.Box)
demesh = DeconstructMesh(Mesh=smesh)  # -> Vertices, Faces, Colours, Normals
mesh = Mesh(Vertices=demesh.Vertices, Faces=demesh.Faces, Component="{ .Mesh")

geo = Geometry(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)
line = Line(geo)
bar = Bar(
    Line=line,
    OrientationAngle=0,
    FeaType="{ \"_t\" : \"System.Enum\", \"TypeName\" : { \"_t\" : \"System.Type\", \"Name\" : \"BH.oM.Structure.Elements.BarFEAType\" }, \"Value\" : \"Flexural\" }",
    Component="{ .Bar")

ln = Line(StartPoint="0,0,0", EndPoint="10,10,10")

sph = Sphere(Base=PlaneXY(0, 0, 0), Radius=Slider(50, range=0..100))

bar_2 = Bar(
    Line=ln,
    OrientationAngle=0,
    FeaType="{ \"_t\" : \"System.Enum\", \"TypeName\" : { \"_t\" : \"System.Type\", \"Name\" : \"BH.oM.Structure.Elements.BarFEAType\" }, \"Value\" : \"Flexural\" }",
    Component="{ .Bar")
bar_3 = Bar(
    Line=line,
    OrientationAngle=0,
    FeaType="{ \"_t\" : \"System.Enum\", \"TypeName\" : { \"_t\" : \"System.Type\", \"Name\" : \"BH.oM.Structure.Elements.BarFEAType\" }, \"Value\" : \"Flexural\" }",
    Component="{ .Bar")
bar_4 = Bar(
    Line=line,
    OrientationAngle=0,
    FeaType="{ \"_t\" : \"System.Enum\", \"TypeName\" : { \"_t\" : \"System.Type\", \"Name\" : \"BH.oM.Structure.Elements.BarFEAType\" }, \"Value\" : \"Flexural\" }",
    Component="{ .Bar")
data = Data([bar, mesh, sph, bar_3, bar_2])
createcustom = CreateCustom(x=mesh, y=mesh, z=bar, Component="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")
createcustom_2 = CreateCustom(x=mesh, y=mesh, z=createcustom, u=bar, Component="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")

# ----
# Enable/disable
# - history (enabled by default)
# - "diffing by GUID" (disabled by default)
createtype = CreateType(Component="System.Object")
createtype_2 = CreateType(Component="System.String")
createdictionary = CreateDictionary(
    Keys=["EnableHistory", "UseGUIDS"],
    Values=[Toggle(True), Toggle(False)],
    KeyType=createtype_2,
    ValueType=createtype,
    Component="{ .CreateDictionary")

# ----
# Set up Speckle Adapter
speckle_he_alessio_lo = Accounts()
anonymous_stream = DataSender(manualmode=False, remotecontroller=False)  # -> Log, StreamId

dam = DataDam(DataA=speckle_he_alessio_lo, BufferDelay=10000000, BufferMode=0)
streams = Streams(Account=speckle_he_alessio_lo)
streams_2 = Streams(Account=dam)
item = ListItem(List=streams_2, Index=0, Wrap=True)  # -> Item1, Item
item_2 = ListItem(List=streams, Index=0, Wrap=True)  # -> Item1, Item
lng = ListLength(List=streams)
eo = ExpandObject(Object=item.Item)  # -> StreamId, Name, Description, Tags, Objects, Layers, BaseProperties, GlobalMeasures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
panel = Panel(lng)

speckleadapter = SpeckleAdapter(SpeckleAccount=dam, SpeckleStreamId=eo.StreamId, Component="{ ..ctor")

# ----
# Push (upload)
toggle = BooleanToggle(True)
push = Push(Adapter=speckleadapter, Objects=flatten(data), Config=createdictionary, Active=toggle, Component="{ .Push")  # -> Objects, Success
panel_2 = Panel(push.Objects)

eo_2 = ExpandObject(Object=item_2.Item)  # -> StreamId, Name, Description, Tags, Objects, Layers, BaseProperties, GlobalMeasures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
eo_3 = ExpandObject(Object=item_2.Item1)  # -> StreamId, Name, Description, Tags, Objects, Layers, BaseProperties, GlobalMeasures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
dam_2 = DataDam(DataA=eo_3.StreamId, BufferDelay=10000000, BufferMode=0)
panel_3 = Panel(eo_2.Children)
panel_4 = Panel(eo_2.Name)
panel_5 = Panel(eo_2.StreamId)
panel_6 = Panel(eo_3.Name)
panel_7 = Panel(dam_2)
panel_8 = Panel(eo_3.StreamId)
item_3 = ListItem(List=flatten(push.Objects), Index=0, Wrap=True)  # -> Item, Item1, Item2, Item3
explode = Explode(Object=item_3.Item, Component="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")  # -> StartNode, EndNode, SectionProperty, OrientationAngle, Release, FEAType, Support, Offset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

# ----
# Pull (download)
pull = Pull(Adapter=speckleadapter, Active=push.Success, Component="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")
panel_9 = Panel(pull)

explode_2 = Explode(Object=explode.CustomData, Component="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")  # -> Speckle_StreamId, Speckle_id
item_4 = ListItem(List=flatten(pull), Index=0, Wrap=True)  # -> Item, Item1, Item2, Item3
item_5 = ListItem(List=item_4.Item, Index=0, Wrap=True)
explode_3 = Explode(Object=item_5, Component="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")  # -> StartNode, EndNode, SectionProperty, OrientationAngle, Release, FEAType, Support, Offset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

# ----
# Pull only certain IDs
panel_10 = Panel()
createtype_3 = CreateType(Component="BH.oM.Base.BHoMObject")
filterquery = FilterQuery(
    Type=createtype_3,
    ObjectIds=panel_10,
    Component="{ \"SelectedItem\" : null, \"InputParams\" : [], \"OutputParams\" : [], \"BHoM_Guid\" : \"e79f2322-e85c-4bb3-8aac-9be96414fe1f\" }")
pull_2 = Pull(Adapter=speckleadapter, Query=filterquery, Active=Toggle(True), Component="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")
panel_11 = Panel(pull_2)

explode_4 = Explode(Object=explode_3.CustomData, Component="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")
