# Grasshopper definition #39-GeomConvAndVisualiz-afterAdapterAlignment.gh (Grasshopper 1.0.7)
# plug-ins: UserDataUtils, BH.UI.Grasshopper

Y = UnitY(Factor=Slider(2, range=0..10))
line = Line([Line((0, -5, 10), (0, 5, 0)), Line((0, -5, 0), (0, 5, 10))])
line_2 = Line(Line((0, 5, 0), (0, 5, 10)))
line_3 = Line(Line((0, -5, 10), (0, 5, 10)))

# ----
# Elements to push
pop3d = Populate3D(Region={Plane=PlaneXY(0, 0, 0), X=Domain(0, 10), Y=Domain(0, 10), Z=Domain(0, 2)}, Count=100, Seed=1)
bbox = BoundingBox(Content=pop3d, Plane=PlaneXY(0, 0, 0), UnionBox=True)  # -> Box, Box_2
smesh = SimpleMesh(Brep=bbox.Box)
demesh = DeconstructMesh(Mesh=smesh)  # -> Vertices, Faces, Colours, Normals
mesh = Mesh(Vertices=demesh.Vertices, Faces=demesh.Faces, Component="{ .Mesh")

pt = Data(Point(13, -2, 0))
chs = CHS(
    {"CHS 21.3x2.6": 0, "CHS 21.3x2.9": 1, "CHS 21.3x3.2": 2, "CHS 26.9x2.6": 3, "CHS 26.9x2.9": 4, "CHS 26.9x3.2": 5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}, selected="CHS 76.1x5.6": 45,
    Component="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",
    Selection=45)
line_4 = Line(Line((0, -5, 0), (0, -5, 10)))
uc = UC(
    {"UC 356x406x1299": 0, "UC 356x406x1202": 1, "UC 356x406x1086": 2, "UC 356x406x990": 3, "UC 356x406x900": 4, "UC 356x406x818": 5, "UC 356x406x744": 6, "UC 356x406x677": 7, "UC 356x406x634": 8, "UC 356x406x592": 9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}, selected="UC 356x406x1086",
    Component="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",
    Selection=2)
L = L(
    {"L 200x150x18.0": 0, "L 200x150x15.0": 1, "L 200x150x12.0": 2, "L 200x100x15.0": 3, "L 200x100x12.0": 4, "L 200x100x10.0": 5, "L 150x90x15.0": 6, "L 150x90x12.0": 7, "L 150x90x10.0": 8, "L 150x75x15.0": 9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}, selected="L 200x150x18.0",
    Component="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",
    Selection=0)
uc_2 = UC(
    {"UC 356x406x1299": 0, "UC 356x406x1202": 1, "UC 356x406x1086": 2, "UC 356x406x990": 3, "UC 356x406x900": 4, "UC 356x406x818": 5, "UC 356x406x744": 6, "UC 356x406x677": 7, "UC 356x406x634": 8, "UC 356x406x592": 9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}, selected="UC 356x406x1086",
    Component="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",
    Selection=2)
ub = UB(
    {"UB 1016x305x584": 0, "UB 1016x305x494": 1, "UB 1016x305x438": 2, "UB 1016x305x415": 3, "UB 1016x305x393": 4, "UB 1016x305x350": 5, "UB 1016x305x314": 6, "UB 1016x305x272": 7, "UB 1016x305x249": 8, "UB 1016x305x222": 9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}, selected="UB 610x178x100": 43,
    Component="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",
    Selection=43)
toggle = BooleanToggle(True)
uc_3 = UC(
    {"UC 356x406x1299": 0, "UC 356x406x1202": 1, "UC 356x406x1086": 2, "UC 356x406x990": 3, "UC 356x406x900": 4, "UC 356x406x818": 5, "UC 356x406x744": 6, "UC 356x406x677": 7, "UC 356x406x634": 8, "UC 356x406x592": 9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}, selected="UC 356x406x1086",
    Component="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",
    Selection=2)
toggle_2 = BooleanToggle(False)
L_2 = L(
    {"L 200x150x18.0": 0, "L 200x150x15.0": 1, "L 200x150x12.0": 2, "L 200x100x15.0": 3, "L 200x100x12.0": 4, "L 200x100x10.0": 5, "L 150x90x15.0": 6, "L 150x90x12.0": 7, "L 150x90x10.0": 8, "L 150x75x15.0": 9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}, selected="L 200x150x18.0",
    Component="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",
    Selection=0)
ub_2 = UB(
    {"UB 1016x305x584": 0, "UB 1016x305x494": 1, "UB 1016x305x438": 2, "UB 1016x305x415": 3, "UB 1016x305x393": 4, "UB 1016x305x350": 5, "UB 1016x305x314": 6, "UB 1016x305x272": 7, "UB 1016x305x249": 8, "UB 1016x305x222": 9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}, selected="UB 1016x305x584",
    Component="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",
    Selection=0)

geo = Geometry(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)
line_5 = Line(geo)
bar = Bar(
    Line=line_5,
    Property=ub_2,
    OrientationAngle=0,
    FeaType="{ \"_t\" : \"System.Enum\", \"TypeName\" : { \"_t\" : \"System.Type\", \"Name\" : \"BH.oM.Structure.Elements.BarFEAType\" }, \"Value\" : \"Flexural\" }",
    Component="{ .Bar")

L_3 = L(
    {"L 200x150x18.0": 0, "L 200x150x15.0": 1, "L 200x150x12.0": 2, "L 200x100x15.0": 3, "L 200x100x12.0": 4, "L 200x100x10.0": 5, "L 150x90x15.0": 6, "L 150x90x12.0": 7, "L 150x90x10.0": 8, "L 150x75x15.0": 9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}, selected="L 200x150x18.0",
    Component="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",
    Selection=0)
ln = Line(StartPoint="0,0,0", EndPoint="10,10,10")
move = Move(Geometry=line_5, Motion=Y)  # -> Geometry, Transform
move_2 = Move(Geometry=move.Geometry, Motion=Y)  # -> Geometry, Transform
move_3 = Move(Geometry=move_2.Geometry, Motion=Y)  # -> Geometry, Transform

sph = Sphere(Base=PlaneXY(0, 0, 0), Radius=Slider(50, range=0..100))

constraint6dof = Constraint6DOF(X=toggle, Y=toggle, Z=toggle, Xx=toggle_2, Yy=toggle_2, Zz=toggle_2, Component="{ .Constraint6DOF")
bar_2 = Bar(
    Line=move_2.Geometry,
    Property=chs,
    OrientationAngle=0,
    FeaType="{ \"_t\" : \"System.Enum\", \"TypeName\" : { \"_t\" : \"System.Type\", \"Name\" : \"BH.oM.Structure.Elements.BarFEAType\" }, \"Value\" : \"Flexural\" }",
    Component="{ .Bar")
bar_3 = Bar(
    Line=move_3.Geometry,
    Property=uc,
    OrientationAngle=0,
    FeaType="{ \"_t\" : \"System.Enum\", \"TypeName\" : { \"_t\" : \"System.Type\", \"Name\" : \"BH.oM.Structure.Elements.BarFEAType\" }, \"Value\" : \"Flexural\" }",
    Component="{ .Bar")
bar_4 = Bar(
    Line=ln,
    Property=L_2,
    OrientationAngle=0,
    FeaType="{ \"_t\" : \"System.Enum\", \"TypeName\" : { \"_t\" : \"System.Type\", \"Name\" : \"BH.oM.Structure.Elements.BarFEAType\" }, \"Value\" : \"Flexural\" }",
    Component="{ .Bar")  # disabled
bar_5 = Bar(
    Line=move.Geometry,
    Property=L,
    OrientationAngle=0,
    FeaType="{ \"_t\" : \"System.Enum\", \"TypeName\" : { \"_t\" : \"System.Type\", \"Name\" : \"BH.oM.Structure.Elements.BarFEAType\" }, \"Value\" : \"Flexural\" }",
    Component="{ .Bar")
bar_6 = Bar(
    Line=line_3,
    Property=ub,
    OrientationAngle=0,
    FeaType="{ \"_t\" : \"System.Enum\", \"TypeName\" : { \"_t\" : \"System.Type\", \"Name\" : \"BH.oM.Structure.Elements.BarFEAType\" }, \"Value\" : \"Flexural\" }",
    Component="{ .Bar")
bar_7 = Bar(
    Line=line_2,
    Property=uc_3,
    OrientationAngle=0,
    FeaType="{ \"_t\" : \"System.Enum\", \"TypeName\" : { \"_t\" : \"System.Type\", \"Name\" : \"BH.oM.Structure.Elements.BarFEAType\" }, \"Value\" : \"Flexural\" }",
    Component="{ .Bar")
bar_8 = Bar(
    Line=line_4,
    Property=uc_2,
    OrientationAngle=0,
    FeaType="{ \"_t\" : \"System.Enum\", \"TypeName\" : { \"_t\" : \"System.Type\", \"Name\" : \"BH.oM.Structure.Elements.BarFEAType\" }, \"Value\" : \"Flexural\" }",
    Component="{ .Bar")
bar_9 = Bar(
    Line=line,
    Property=L_3,
    OrientationAngle=0,
    FeaType="{ \"_t\" : \"System.Enum\", \"TypeName\" : { \"_t\" : \"System.Type\", \"Name\" : \"BH.oM.Structure.Elements.BarFEAType\" }, \"Value\" : \"Flexural\" }",
    Component="{ .Bar")
node = Node(
    Position=pt,
    Orientation="{ \"_t\" : \"BH.oM.Geometry.Basis\", \"X\" : { \"_t\" : \"BH.oM.Geometry.Vector\", \"X\" : 1.0, \"Y\" : 0.0, \"Z\" : 0.0 }, \"Y\" : { \"_t\" : \"BH.oM.Geometry.Vector\", \"X\" : 0.0, \"Y\" : 1.0, \"Z\" : 0.0 }, \"Z\" : { \"_t\" : \"BH.oM.Geometry.Vector\", \"X\" : 0.0, \"Y\" : 0.0, \"Z\" : 1.0 } }",
    Support=constraint6dof,
    Component="BH.oM.Structure.Elements.Node")
dam = DataDam(DataA=Slider(9, range=0..10), BufferDelay=10000000, BufferMode=2)
data = Data([bar, bar_5, bar_2, bar_3, bar_4])
bar_10 = Bar(
    Line=line_5,
    Property=ub_2,
    OrientationAngle=0,
    FeaType="{ \"_t\" : \"System.Enum\", \"TypeName\" : { \"_t\" : \"System.Type\", \"Name\" : \"BH.oM.Structure.Elements.BarFEAType\" }, \"Value\" : \"Flexural\" }",
    Component="{ .Bar")
division = Division(A=dam, B=2)
division_2 = Division(A=dam, B=2)
createcustom = CreateCustom(x=mesh, y=mesh, z=bar, Component="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")
dam_2 = DataDam(DataA=data, BufferDelay=10000000, BufferMode=0)
merge = Merge(Data1=bar_8, Data2=bar_6, Data3=bar_7, Data4=node, Data5=bar_9)
neg = Negative(Value=division)
pt_2 = ConstructPoint(XCoordinate=division, YCoordinate=division_2, ZCoordinate=dam)

# ----
# Set up Speckle Adapter
speckle_he_alessio_lo = Accounts(email="alessio.lombardi@burohappold.com", restapi="https://hestia.speckle.works/api/v1")
anonymous_stream = DataSender(manualmode=False, remotecontroller=False)  # -> Log, StreamId
speckleadapter = SpeckleAdapter(SpeckleAccount=speckle_he_alessio_lo, SpeckleStreamId=anonymous_stream.StreamId, Component="{ ..ctor")
speckleadapter_2 = Data(speckleadapter)

createcustom_2 = CreateCustom(x=mesh, y=mesh, z=createcustom, u=bar, Component="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")
pt_3 = ConstructPoint(XCoordinate=neg, YCoordinate=division_2, ZCoordinate=dam)
uc_4 = UC(
    {"UC 356x406x1299": 0, "UC 356x406x1202": 1, "UC 356x406x1086": 2, "UC 356x406x990": 3, "UC 356x406x900": 4, "UC 356x406x818": 5, "UC 356x406x744": 6, "UC 356x406x677": 7, "UC 356x406x634": 8, "UC 356x406x592": 9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}, selected="UC 356x406x1086",
    Component="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",
    Selection=2)

# ----
# Enable/disable
# - history (enabled by default)
# - "diffing by GUID" (disabled by default)
createtype = CreateType(Component="System.Object")
createtype_2 = CreateType(Component="System.String")
createdictionary = CreateDictionary(
    Keys=["EnableHistory", "UseGUIDS"],
    Values=[Toggle(True), Toggle(False)],
    KeyType=createtype_2,
    ValueType=createtype,
    Component="{ .CreateDictionary")

# ----
# Verify if you are writing "History" or not
# = if the pushConfig EnableHistory is true,
# the total number of streams in the account
# will increase.
speckleaccount = Data(speckle_he_alessio_lo)
streams = Streams(Account=speckleaccount)
item = ListItem(List=streams, Index=0, Wrap=True)  # -> Item1, Item
lng = ListLength(List=streams)
panel = Panel(lng)
eo = ExpandObject(Object=item.Item)  # -> StreamId, Name, Description, Tags, Objects, Layers, BaseProperties, GlobalMeasures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
eo_2 = ExpandObject(Object=item.Item1)  # -> StreamId, Name, Description, Tags, Objects, Layers, BaseProperties, GlobalMeasures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
dam_3 = DataDam(DataA=eo_2.StreamId, BufferDelay=10000000, BufferMode=0)
panel_2 = Panel(eo.Children)
panel_3 = Panel(eo.Name)
panel_4 = Panel(eo.StreamId)
panel_5 = Panel(eo_2.Name)
panel_6 = Panel(eo_2.StreamId)
panel_7 = Panel(dam_3)

ln_2 = Line(StartPoint=pt_3, EndPoint=pt_2)
X = UnitX(Factor=Slider(3, range=0..10))
panel_8 = Panel("4,8,3")
panel_9 = Panel("5,8,3")
bar_11 = Bar(
    Line=ln_2,
    OrientationAngle=0,
    FeaType="{ \"_t\" : \"System.Enum\", \"TypeName\" : { \"_t\" : \"System.Type\", \"Name\" : \"BH.oM.Structure.Elements.BarFEAType\" }, \"Value\" : \"Flexural\" }",
    Component="{ .Bar")
move_4 = Move(Geometry="3,5,6", Motion=X)  # -> Geometry, Transform
panel_10 = Panel("1,2,4")
of_storeys = Slider(3, range=0..10)
no_of_x_columns = Slider(4, range=0..10)
no_of_y_columns = Slider(2, range=0..10)
z_height = Slider(3.6, range=2.5..5)
node_2 = Node(Position="8,9,5", Component="BH.oM.Environment.Elements.Node")
toggle_3 = BooleanToggle(True)
toggle_4 = BooleanToggle(False)
constraint6dof_2 = Constraint6DOF(X=toggle_3, Y=toggle_3, Z=toggle_3, Xx=toggle_4, Yy=toggle_4, Zz=toggle_4, Component="{ .Constraint6DOF")
constraint6dof_3 = Constraint6DOF(X=toggle_3, Y=toggle_3, Z=toggle_3, Xx=toggle_3, Yy=toggle_3, Zz=toggle_3, Component="{ .Constraint6DOF")
node_3 = Node(
    Position=move_4.Geometry,
    Orientation="{ \"_t\" : \"BH.oM.Geometry.Basis\", \"X\" : { \"_t\" : \"BH.oM.Geometry.Vector\", \"X\" : 1.0, \"Y\" : 0.0, \"Z\" : 0.0 }, \"Y\" : { \"_t\" : \"BH.oM.Geometry.Vector\", \"X\" : 0.0, \"Y\" : 1.0, \"Z\" : 0.0 }, \"Z\" : { \"_t\" : \"BH.oM.Geometry.Vector\", \"X\" : 0.0, \"Y\" : 0.0, \"Z\" : 1.0 } }",
    Support=constraint6dof_3,
    Component="BH.oM.Structure.Elements.Node")
uc_5 = UC(
    {"UC 356x406x1299": 0, "UC 356x406x1202": 1, "UC 356x406x1086": 2, "UC 356x406x990": 3, "UC 356x406x900": 4, "UC 356x406x818": 5, "UC 356x406x744": 6, "UC 356x406x677": 7, "UC 356x406x634": 8, "UC 356x406x592": 9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}, selected="UC 356x406x509": 11,
    Component="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",
    Selection=11)
ln_3 = Line(StartPoint="3,5,6", EndPoint=move_4.Geometry)
node_4 = Node(
    Position="3,5,6",
    Orientation="{ \"_t\" : \"BH.oM.Geometry.Basis\", \"X\" : { \"_t\" : \"BH.oM.Geometry.Vector\", \"X\" : 1.0, \"Y\" : 0.0, \"Z\" : 0.0 }, \"Y\" : { \"_t\" : \"BH.oM.Geometry.Vector\", \"X\" : 0.0, \"Y\" : 1.0, \"Z\" : 0.0 }, \"Z\" : { \"_t\" : \"BH.oM.Geometry.Vector\", \"X\" : 0.0, \"Y\" : 0.0, \"Z\" : 1.0 } }",
    Support=constraint6dof_2,
    Component="BH.oM.Structure.Elements.Node")
uc_6 = UC(
    {"UC 356x406x1299": 0, "UC 356x406x1202": 1, "UC 356x406x1086": 2, "UC 356x406x990": 3, "UC 356x406x900": 4, "UC 356x406x818": 5, "UC 356x406x744": 6, "UC 356x406x677": 7, "UC 356x406x634": 8, "UC 356x406x592": 9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}, selected="UC 356x406x509": 11,
    Component="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",
    Selection=11)
bar_12 = Bar(
    Line=ln_3,
    Property=uc_5,
    OrientationAngle=0,
    FeaType="{ \"_t\" : \"System.Enum\", \"TypeName\" : { \"_t\" : \"System.Type\", \"Name\" : \"BH.oM.Structure.Elements.BarFEAType\" }, \"Value\" : \"Flexural\" }",
    Component="{ .Bar")

# ----
# - First column
height = Slider(3.6, range=2.5..5)
# Same tower model, redone to allow:
# - no floor mesh
# - definition of beams
panel_11 = Panel("0,0,0")
z_height_2 = Data(z_height)
Z = UnitZ(Factor=z_height_2)
move_5 = Move(Geometry=panel_11, Motion=Z)  # -> Geometry, Transform
ln_4 = Line(StartPoint=panel_11, EndPoint=move_5.Geometry)
first_column = Line(ln_4)

# ----
# - Create a portal in X direction: "portal_x"
number_slider = Slider(5, range=0..5)
portalxwidth = Data(number_slider)

bar_13 = Bar(
    StartNode=node_4,
    EndNode=node_3,
    SectionProperty=uc_6,
    OrientationAngle=0,
    FEAType="{ \"_t\" : \"System.Enum\", \"TypeName\" : { \"_t\" : \"System.Type\", \"Name\" : \"BH.oM.Structure.Elements.BarFEAType\" }, \"Value\" : \"Flexural\" }",
    Component="BH.oM.Structure.Elements.Bar")

# ----
# Push (upload)
toggle_5 = BooleanToggle(True)
speckleadapter_3 = Data(speckleadapter_2)
push = Push(
    Adapter=speckleadapter_3,
    Objects=flatten(merge),
    PushType="{ \"_t\" : \"System.Enum\", \"TypeName\" : { \"_t\" : \"System.Type\", \"Name\" : \"BH.oM.Adapter.PushType\" }, \"Value\" : \"AdapterDefault\" }",
    Active=toggle_5,
    Component="{ .Push")  # -> Objects, Success
panel_12 = Panel(push.Objects)

# ----
# Create portal columns
first_column_2 = Line(first_column)
X_2 = UnitX(Factor=portalxwidth)
move_6 = Move(Geometry=first_column_2, Motion=X_2)  # -> Geometry, Transform
merge_2 = Merge(Data1=first_column_2, Data2=move_6.Geometry)
portalcolumns = Line(merge_2)

# ----
# Create portal beam
portalcolumns_2 = Line(portalcolumns)
end = EndPoints(Curve=portalcolumns_2)  # -> Start, End
portaltoppoints = Point(end.End)
item_2 = ListItem(List=portaltoppoints, Index=0, Wrap=True)  # -> Item, Item1
ln_5 = Line(StartPoint=item_2.Item, EndPoint=item_2.Item1)

no_of_x_columns_2 = Integer(no_of_x_columns)

# ----
# Put together beam and columns
portalcolumns_3 = Line(portalcolumns)
portalbeam = Data(ln_5)
merge_3 = Merge(Data1=portalcolumns_3, Data2=portalbeam)
portal_x = Line(merge_3)

# ----
# - Repeat the "portal_x" in the X direction: we get a ROW of portal_x
# - Create a portal in Y direction: "portal_y"
number_slider_2 = Slider(8, range=0..10)
series = Series(Start=0, Step=1, Count=no_of_x_columns_2)
portalxwidth_2 = Data(number_slider)
multiplication = Multiplication(A=series, B=portalxwidth_2)
X_3 = UnitX(Factor=multiplication)
portal_x_2 = Line(portal_x)
move_7 = Move(Geometry=portal_x_2, Motion=graft(X_3))  # -> simplify(Geometry), Transform
portal_x_row = Line(move_7.Geometry)

of_storeys_2 = Data(of_storeys)
number_slider_3 = Slider(1, range=0..10)
item_3 = ListItem(List=flatten(push.Objects), Index=0, Wrap=True)  # -> Item, Item1, Item2, Item3

# ----
# Pull (download)
speckleadapter_4 = Data(speckleadapter_2)
pull = Pull(
    Adapter=speckleadapter_4,
    PullType="{ \"_t\" : \"System.Enum\", \"TypeName\" : { \"_t\" : \"System.Type\", \"Name\" : \"BH.oM.Adapter.PullType\" }, \"Value\" : \"AdapterDefault\" }",
    Active=push.Success,
    Component="{ .Pull")
panel_13 = Panel(pull)

explode = Explode(Object=item_3.Item, Component="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")  # -> StartNode, EndNode, SectionProperty, OrientationAngle, Release, FEAType, Support, Offset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
explode_2 = Explode(Object=explode.CustomData, Component="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")
item_4 = ListItem(List=flatten(pull), Index=0, Wrap=True)  # -> Item, Item1, Item2, Item3
item_5 = ListItem(List=item_4.Item, Index=0, Wrap=True)
explode_3 = Explode(Object=item_5, Component="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")  # -> StartNode, EndNode, SectionProperty, OrientationAngle, Release, FEAType, Support, Offset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
explode_4 = Explode(Object=explode_3.CustomData, Component="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")  # -> Speckle_StreamId, Speckle_id

# ----
# Complex Push
starter_curve = Curve(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)

# ----
# Define constraint
toggle_6 = BooleanToggle(True)
toggle_7 = BooleanToggle(True)
constraint6dof_4 = Constraint6DOF(X=toggle_6, Y=toggle_6, Z=toggle_6, Xx=toggle_7, Yy=toggle_7, Zz=toggle_7, Component="{ .Constraint6DOF")

ub_3 = UB(
    {"UB 1016x305x584": 0, "UB 1016x305x494": 1, "UB 1016x305x438": 2, "UB 1016x305x415": 3, "UB 1016x305x393": 4, "UB 1016x305x350": 5, "UB 1016x305x314": 6, "UB 1016x305x272": 7, "UB 1016x305x249": 8, "UB 1016x305x222": 9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}, selected="UB 533x312x219": 47,
    Component="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",
    Selection=47)
ub_4 = UB(
    {"UB 1016x305x584": 0, "UB 1016x305x494": 1, "UB 1016x305x438": 2, "UB 1016x305x415": 3, "UB 1016x305x393": 4, "UB 1016x305x350": 5, "UB 1016x305x314": 6, "UB 1016x305x272": 7, "UB 1016x305x249": 8, "UB 1016x305x222": 9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}, selected="UB 254x102x28": 98,
    Component="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",
    Selection=98)
chs_2 = CHS(
    {"CHS 21.3x2.6": 0, "CHS 21.3x2.9": 1, "CHS 21.3x3.2": 2, "CHS 26.9x2.6": 3, "CHS 26.9x2.9": 4, "CHS 26.9x3.2": 5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}, selected="CHS 21.3x2.6",
    Component="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",
    Selection=0)
L_4 = L(
    {"L 200x150x18.0": 0, "L 200x150x15.0": 1, "L 200x150x12.0": 2, "L 200x100x15.0": 3, "L 200x100x12.0": 4, "L 200x100x10.0": 5, "L 150x90x15.0": 6, "L 150x90x12.0": 7, "L 150x90x10.0": 8, "L 150x75x15.0": 9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}, selected="L 50x30x5.0": 33,
    Component="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",
    Selection=33)
L_5 = L(
    {"L 200x150x18.0": 0, "L 200x150x15.0": 1, "L 200x150x12.0": 2, "L 200x100x15.0": 3, "L 200x100x12.0": 4, "L 200x100x10.0": 5, "L 150x90x15.0": 6, "L 150x90x12.0": 7, "L 150x90x10.0": 8, "L 150x75x15.0": 9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}, selected="L 80x40x6.0": 25,
    Component="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",
    Selection=25)
L_6 = L(
    {"L 200x150x18.0": 0, "L 200x150x15.0": 1, "L 200x150x12.0": 2, "L 200x100x15.0": 3, "L 200x100x12.0": 4, "L 200x100x10.0": 5, "L 150x90x15.0": 6, "L 150x90x12.0": 7, "L 150x90x10.0": 8, "L 150x75x15.0": 9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}, selected="L 200x150x18.0",
    Component="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",
    Selection=0)

# ----
# Create portal columns
number_slider_4 = Slider(7.6, range=0..8)
first_column_3 = Line(first_column)

portalywidth = Data(number_slider_4)

Y_2 = UnitY(Factor=portalywidth)
move_8 = Move(Geometry=first_column_3, Motion=Y_2)  # -> Geometry, Transform
merge_4 = Merge(Data1=first_column_3, Data2=move_8.Geometry)
portalcolumns_4 = Line(merge_4)

# ----
# Create portal beam
portalcolumns_5 = Line(portalcolumns_4)
end_2 = EndPoints(Curve=portalcolumns_5)  # -> Start, End
portaltoppoints_2 = Point(end_2.End)
item_6 = ListItem(List=portaltoppoints_2, Index=0, Wrap=True)  # -> Item, Item1
ln_6 = Line(StartPoint=item_6.Item, EndPoint=item_6.Item1)

# ----
# Put together beam and columns
portalcolumns_6 = Line(portalcolumns_4)
portalbeam_2 = Data(ln_6)
merge_5 = Merge(Data1=portalcolumns_6, Data2=portalbeam_2)
portal_y = Line(merge_5)

# ----
# - Repeat "portal_y" in the Y direction: we get a ROW of portal_y
number_slider_5 = Slider(2, range=0..10)
no_of_y_columns_2 = Integer(no_of_y_columns)
portalywidth_2 = Data(portalywidth)
series_2 = Series(Start=0, Step=1, Count=no_of_y_columns_2)
multiplication_2 = Multiplication(A=series_2, B=portalywidth_2)
Y_3 = UnitY(Factor=multiplication_2)
portal_y_2 = Line(merge_5)
move_9 = Move(Geometry=portal_y_2, Motion=graft(Y_3))  # -> simplify(Geometry), Transform
portal_y_row = Line(move_9.Geometry)

# ----
# Repeat the "portal_y"s in the X direction
no_of_x_columns_3 = Integer(no_of_x_columns_2)
series_3 = Series(Start=0, Step=1, Count=no_of_x_columns_3)  # -> expr("x+1", Series)
portalxwidth_3 = Data(portalxwidth)
multiplication_3 = Multiplication(A=series_3, B=portalxwidth_3)
portal_y_row_2 = Line(portal_y_row)
X_4 = UnitX(Factor=multiplication_3)
move_10 = Move(Geometry=graft(portal_y_row_2), Motion=flatten(X_4))  # -> simplify(Geometry), Transform
merge_6 = Merge(Data1=portal_y_row_2, Data2=move_10.Geometry)
all_portal_y_s = Line(merge_6)

# ----
# Repeat the storey in Z direction: get the full model
number_slider_6 = Slider(8, range=0..10)
z_height_3 = Data(z_height_2)
series_4 = Series(Start=0, Step=1, Count=of_storeys_2)  # -> expr("x+1", Series)
multiplication_4 = Multiplication(A=series_4, B=z_height_3)
Z_2 = UnitZ(Factor=multiplication_4)

# ----
# Repeat the "portal_x"s in the Y direction
no_of_y_columns_3 = Integer(no_of_y_columns_2)
series_5 = Series(Start=0, Step=1, Count=no_of_y_columns_3)  # -> expr("x+1", Series)
portalywidth_3 = Data(number_slider_4)
multiplication_5 = Multiplication(A=series_5, B=portalywidth_3)
portal_x_row_2 = Line(portal_x_row)

# ----
# - Create the storey
Y_4 = UnitY(Factor=multiplication_5)

# ---- group: (Tangent) X (Z-vector)
Z_3 = UnitZ(Factor=1)

Z_4 = UnitZ(Factor=1)

# ---- group: We need only endpoints with Z height of 0: get a pattern of True/False
# Instead of using "Equals" feeding it a value of 0,
# I use "Smaller than" with a number close to zero
# to handle possible numerical imprecisions
number_slider_7 = Slider(0.001, range=0..0.001)

# ----
move_11 = Move(Geometry=graft(portal_x_row_2), Motion=flatten(Y_4))  # -> simplify(Geometry), Transform

# ---- group: Cross-product must be ONE for vertical lines: get a pattern of True/False
# Instead of using "Equals" feeding it a value of 1,
# I use "Larger than" with a number close to one
# to handle possible numerical imprecisions
number_slider_8 = Slider(0.999, range=0..1)

# ---- group: Cross-product must be zero for vertical lines: get a pattern of True/False
# Instead of using "Equals" feeding it a value of 0,
# I use "Smaller than" with a number close to zero
# to handle possible numerical imprecisions
number_slider_9 = Slider(0.001, range=0..0.001)

# ----
merge_7 = Merge(Data1=portal_x_row_2, Data2=move_11.Geometry)

all_portal_x_s = Line(merge_7)

merge_8 = Merge(Data1=all_portal_x_s, Data2=all_portal_y_s)  # -> flatten(Result)
cullduplicatelines = CSharpScript(lines=merge_8)  # -> A; inputs lines: list of Line
# ---------- cullduplicatelines: C# ----------
    A = lines.Distinct(); // removes the duplicate lines
# ---------- end cullduplicatelines ----------
complete_storey = Line(cullduplicatelines)

complete_storey_2 = Line(complete_storey)

move_12 = Move(Geometry=flatten(complete_storey_2), Motion=graft(Z_2))  # -> simplify(Geometry), Transform

entwine = Entwine(Branch0X=complete_storey_2, Branch1X=move_12.Geometry, FlattenInputs=False)

# ---- group: TOWER MODEL
complete_tower_model = Geometry(entwine)

# Filter grasshopper elements: only vertical lines
# (--> will be our columns)
complete_tower_model_2 = Geometry(complete_tower_model)

# Filter grasshopper elements: only HORIZONTAL lines
# (--> will be our beams)
complete_tower_model_3 = Geometry(complete_tower_model)

# Filter grasshopper elements:
# base support points
complete_tower_model_4 = Geometry(complete_tower_model)

# ---- group: Take all curve endpoints
end_3 = EndPoints(Curve=complete_tower_model_4)  # -> Start, End
merge_9 = Merge(Data1=end_3.Start, Data2=end_3.End)
flatten = FlattenTree(Tree=merge_9, Path="{0}")

# ---- group: Get the tangent of all curves in their middle point (0.5)
eval = EvaluateCurve(Curve=complete_tower_model_2, Parameter=Slider(0.5, range=0..1))  # -> Point, Tangent, Angle

eval_2 = EvaluateCurve(Curve=complete_tower_model_3, Parameter=Slider(0.5, range=0..1))  # -> Point, Tangent, Angle

# ---- group: (Tangent) X (Z-vector) (continued)
xprod = CrossProduct(VectorA=eval.Tangent, VectorB=Z_3, Unitize=False)  # -> Vector, Length

xprod_2 = CrossProduct(VectorA=eval_2.Tangent, VectorB=Z_4, Unitize=False)  # -> Vector, Length

# ---- group: We need only endpoints with Z height of 0: get a pattern of True/False (continued)
pdecon = Deconstruct(Point=flatten)  # -> XComponent, YComponent, ZComponent
smaller = SmallerThan(FirstNumber=pdecon.ZComponent, SecondNumber=number_slider_7)  # -> SmallerThan, OrEqualTo

# ---- group: Cross-product must be ONE for vertical lines: get a pattern of True/False (continued)
larger = LargerThan(FirstNumber=xprod_2.Vector, SecondNumber=number_slider_8)  # -> LargerThan, OrEqualTo

# ---- group: Cross-product must be zero for vertical lines: get a pattern of True/False (continued)
smaller_2 = SmallerThan(FirstNumber=xprod.Vector, SecondNumber=number_slider_9)  # -> SmallerThan, OrEqualTo

# ---- group: Filter (cull out) using the pattern
cull = CullPattern(List=flatten, CullPattern=smaller.SmallerThan)

cull_2 = CullPattern(List=complete_tower_model_2, CullPattern=smaller_2.SmallerThan)

cull_3 = CullPattern(List=complete_tower_model_3, CullPattern=larger.LargerThan)

# ----
# x,y,z = translations
# xx, yy, zz = rotations
support_points = Point(cull)
columns = Data(cull_2)
beams = Data(cull_3)
scale = Scale(Geometry=support_points, Center=Point(0, 0, 0), Factor=number_slider_3)  # -> Geometry, Transform
scale_2 = Scale(Geometry=columns, Center=Point(0, 0, 0), Factor=number_slider_3)  # -> Geometry, Transform
scale_3 = Scale(Geometry=beams, Center=Point(0, 0, 0), Factor=number_slider_3)  # -> Geometry, Transform

# ----
# Define the bars for the beams
ub_5 = UB(
    {"UB 1016x305x584": 0, "UB 1016x305x494": 1, "UB 1016x305x438": 2, "UB 1016x305x415": 3, "UB 1016x305x393": 4, "UB 1016x305x350": 5, "UB 1016x305x314": 6, "UB 1016x305x272": 7, "UB 1016x305x249": 8, "UB 1016x305x222": 9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}, selected="UB 1016x305x584",
    Component="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",
    Selection=0)
bar_14 = Bar(
    Line=scale_3.Geometry,
    Property=ub_5,
    OrientationAngle=0,
    FeaType="{ \"_t\" : \"System.Enum\", \"TypeName\" : { \"_t\" : \"System.Type\", \"Name\" : \"BH.oM.Structure.Elements.BarFEAType\" }, \"Value\" : \"Flexural\" }",
    Component="{ .Bar")

# ----
# Define the bars for the columns
uc_7 = UC(
    {"UC 356x406x1299": 0, "UC 356x406x1202": 1, "UC 356x406x1086": 2, "UC 356x406x990": 3, "UC 356x406x900": 4, "UC 356x406x818": 5, "UC 356x406x744": 6, "UC 356x406x677": 7, "UC 356x406x634": 8, "UC 356x406x592": 9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}, selected="UC 356x406x1299",
    Component="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",
    Selection=0)
bar_15 = Bar(
    Line=scale_2.Geometry,
    Property=uc_7,
    OrientationAngle=0,
    FeaType="{ \"_t\" : \"System.Enum\", \"TypeName\" : { \"_t\" : \"System.Type\", \"Name\" : \"BH.oM.Structure.Elements.BarFEAType\" }, \"Value\" : \"Flexural\" }",
    Component="{ .Bar")

# ----
# Define pinned support points
toggle_8 = BooleanToggle(True)
toggle_9 = BooleanToggle(False)
constraint6dof_5 = Constraint6DOF(X=toggle_8, Y=toggle_8, Z=toggle_8, Xx=toggle_9, Yy=toggle_9, Zz=toggle_9, Component="{ .Constraint6DOF")
pin_constraint = Data(constraint6dof_5)
node_5 = Node(Coordinates=scale.Geometry, Support=pin_constraint, Component="{ .Node")

merge_10 = Merge(Data1=bar_15, Data2=bar_14)
dam_4 = DataDam(DataA=merge_10, BufferDelay=20000000, BufferMode=0)

# ----
# Pull only certain IDs
panel_14 = Panel()
createtype_3 = CreateType(Component="BH.oM.Base.BHoMObject")
filterrequest = FilterRequest(Type=createtype_3, ObjectIds=panel_14, Component="{ .FilterRequest")

pull_2 = Pull(
    Adapter=speckleadapter_2,
    Request=filterrequest,
    PullType="{ \"_t\" : \"System.Enum\", \"TypeName\" : { \"_t\" : \"System.Type\", \"Name\" : \"BH.oM.Adapter.PullType\" }, \"Value\" : \"AdapterDefault\" }",
    Active=Toggle(True),
    Component="{ .Pull")

panel_15 = Panel(pull_2)

# ----
# - Remember what we said about Data Trees? Have a look at how complex a definition can become. Double click the component to access its contents.
#    Can you understand it? For this course, we will always try to generate things in a simpler way than that.
# 
# - Try to export this truss definition to GSA using the Push.
# 
# - (Optional) For the more advanced/proficient with GH, you can play around with the cluster component;
#    try to understand how it is built.
truss_generator = TrussGenerator(
    starter_curve=starter_curve,
    number_of_primary_truss_curves=Slider(7, range=0..10),
    number_of_divisions_in_truss=Slider(6, range=0..10))  # -> primary_truss_chords_2, primary_truss_verticals_2, primary_truss_bracing_2, secondary_truss_chords_2, secondary_truss_bracing_2, plan_bracing_2, top_support_points_2, bottom_support_points_2

secondary_truss_bracing = Curve(truss_generator.secondary_truss_bracing_2)
secondary_truss_chords = Curve(truss_generator.secondary_truss_chords_2)
bottom_support_points = Point(truss_generator.bottom_support_points_2)
primary_truss_verticals = Curve(truss_generator.primary_truss_verticals_2)
primary_truss_bracing = Curve(truss_generator.primary_truss_bracing_2)
primary_truss_chords = Curve(truss_generator.primary_truss_chords_2)
top_support_points = Point(truss_generator.top_support_points_2)
plan_bracing = Curve(truss_generator.plan_bracing_2)

# ----
# Define support Nodes
top_support_points_2 = Point(top_support_points)
bottom_support_points_2 = Point(truss_generator.bottom_support_points_2)
node_6 = Node(Position=bottom_support_points_2, Support=constraint6dof_4, Component="{ .Node")
node_7 = Node(Position=top_support_points_2, Support=constraint6dof_4, Component="{ .Node")
support_nodes = Data([node_7, node_6])

bar_16 = Bar(
    Line=secondary_truss_bracing,
    Property=L_5,
    OrientationAngle=0,
    FeaType="{ \"_t\" : \"System.Enum\", \"TypeName\" : { \"_t\" : \"System.Type\", \"Name\" : \"BH.oM.Structure.Elements.BarFEAType\" }, \"Value\" : \"Flexural\" }",
    Component="{ .Bar")
bar_17 = Bar(
    Line=plan_bracing,
    Property=L_4,
    OrientationAngle=0,
    FeaType="{ \"_t\" : \"System.Enum\", \"TypeName\" : { \"_t\" : \"System.Type\", \"Name\" : \"BH.oM.Structure.Elements.BarFEAType\" }, \"Value\" : \"Flexural\" }",
    Component="{ .Bar")
bar_18 = Bar(
    Line=primary_truss_bracing,
    Property=L_6,
    OrientationAngle=0,
    FeaType="{ \"_t\" : \"System.Enum\", \"TypeName\" : { \"_t\" : \"System.Type\", \"Name\" : \"BH.oM.Structure.Elements.BarFEAType\" }, \"Value\" : \"Flexural\" }",
    Component="{ .Bar")
bar_19 = Bar(
    Line=secondary_truss_chords,
    Property=ub_4,
    OrientationAngle=0,
    FeaType="{ \"_t\" : \"System.Enum\", \"TypeName\" : { \"_t\" : \"System.Type\", \"Name\" : \"BH.oM.Structure.Elements.BarFEAType\" }, \"Value\" : \"Flexural\" }",
    Component="{ .Bar")
bar_20 = Bar(
    Line=primary_truss_verticals,
    Property=chs_2,
    OrientationAngle=0,
    FeaType="{ \"_t\" : \"System.Enum\", \"TypeName\" : { \"_t\" : \"System.Type\", \"Name\" : \"BH.oM.Structure.Elements.BarFEAType\" }, \"Value\" : \"Flexural\" }",
    Component="{ .Bar")
bar_21 = Bar(
    Line=primary_truss_chords,
    Property=ub_3,
    OrientationAngle=0,
    FeaType="{ \"_t\" : \"System.Enum\", \"TypeName\" : { \"_t\" : \"System.Type\", \"Name\" : \"BH.oM.Structure.Elements.BarFEAType\" }, \"Value\" : \"Flexural\" }",
    Component="{ .Bar")

merge_11 = Merge(Data1=bar_21, Data4=bar_19)  # -> flatten(Result)
dam_5 = DataDam(DataA=merge_11, BufferDelay=20000000, BufferMode=0)

# ----
# Push Model
toggle_10 = BooleanToggle(False)
gsa_adapter = Data()
push_2 = Push(
    Adapter=gsa_adapter,
    Objects=flatten(merge_11),
    PushType="{ \"_t\" : \"System.Enum\", \"TypeName\" : { \"_t\" : \"System.Type\", \"Name\" : \"BH.oM.Adapter.PushType\" }, \"Value\" : \"AdapterDefault\" }",
    Active=toggle_10,
    Component="{ .Push")  # -> Objects, Success

# ==== cluster TrussGenerator
number_of_primary_truss_curves = ClusterInput()
starter_curve = ClusterInput()

# ----
# Arraying the Curve in a Circular Formation
number_of_primary_truss_curves_2 = Number(number_of_primary_truss_curves)
pi = Pi(Factor=1)
division = Division(A=pi, B="2")
starter_curve_2 = Curve(starter_curve)
range = Range(Domain=division, Steps=number_of_primary_truss_curves_2)
xy = XYPlane(Origin=Point(0, 0, 0))
rotate = Rotate(Geometry=starter_curve_2, Angle=range, Plane=xy)  # -> Geometry, Transform
arrayed_curve = Curve(rotate.Geometry)

number_of_divisions_in_truss = ClusterInput()

# ----
# Dividing Arrayed Curves
number_of_divisions_in_truss_2 = Number(number_of_divisions_in_truss)
arrayed_curve_2 = Curve(arrayed_curve)
divide = DivideCurve(Curve=arrayed_curve_2, Count=number_of_divisions_in_truss_2, Kinks=False)  # -> simplify(Points), Tangents, Parameters
point_grid = Point(simplify(divide.Points))

# ----
# Vertically Offset Points to Create Truss
point_grid_2 = Point(simplify(point_grid))
series = Series(Start=0, Step="1.5", Count="2")
Z = UnitZ(Factor=series)
move = Move(Geometry=graft(point_grid_2), Motion=simplify(Z))  # -> Geometry, Transform
offset_point_grid = Point(simplify(move.Geometry))

# ----
# Shifting Point Lists to Draw Diagonals
toggle = BooleanToggle(False)
offset_point_grid_2 = Point(simplify(offset_point_grid))
offset_point_grid_3 = Point(simplify(offset_point_grid))
shift = ShiftList(List=offset_point_grid_2, Shift=1, Wrap=toggle)
short = ShortestList(ListA=offset_point_grid_3, ListB=shift, TrimMode=2)  # -> simplify(ListA), simplify(ListB)
shifted_point_list_top_chord = Point(short.ListB)
shifted_point_list_bottom_chord = Point(short.ListA)

# ----
# Drawing Plan Bracing
point_grid_3 = Point(simplify(point_grid))
point_grid_4 = Point(simplify(point_grid))
shift_2 = ShiftList(List=point_grid_3, Shift=1, Wrap=False)
short_2 = ShortestList(ListA=point_grid_4, ListB=shift_2, TrimMode=2)  # -> ListA, ListB
flip = FlipMatrix(Data=short_2.ListB)
flip_2 = FlipMatrix(Data=short_2.ListA)
shift_3 = ShiftList(List=flip, Shift=1, Wrap=False)
short_3 = ShortestList(ListA=flip_2, ListB=shift_3, TrimMode=2)  # -> ListA, ListB
ln = Line(StartPoint=short_3.ListA, EndPoint=short_3.ListB)
plan_bracing = Curve(ln)

# ----
# Draw Truss Chords
offset_point_grid_4 = Point(simplify(offset_point_grid))
path_mapper = PathMapper(offset_point_grid_4, source="{A;B}(i)", target="{A;i}(B)")
pline = PolyLine(Vertices=path_mapper, Closed=False)
explode = Explode(Curve=pline, Recursive=True)  # -> Segments, Vertices
primary_truss_chords = Curve(explode.Segments)

# ----
# Draw Truss Verticals
offset_point_grid_5 = Point(simplify(offset_point_grid))
pline_2 = PolyLine(Vertices=offset_point_grid_5, Closed=False)
explode_2 = Explode(Curve=pline_2, Recursive=True)  # -> Segments, Vertices
primary_truss_verticals = Curve(explode_2.Segments)

# ----
# Draw Secondary Beams
offset_point_grid_6 = Point(simplify(offset_point_grid))
path_mapper_2 = PathMapper(offset_point_grid_6, source="{A;B}(i)", target="{i;B}(A)")
pline_3 = PolyLine(Vertices=path_mapper_2, Closed=False)
explode_3 = Explode(Curve=pline_3, Recursive=True)  # -> Segments, Vertices
secondary_truss_chords = Curve(explode_3.Segments)

# ----
# Draw Bracing for Secondary Trusses
shifted_point_list_bottom_chord_2 = Point(shifted_point_list_bottom_chord)
shifted_point_list_top_chord_2 = Point(shifted_point_list_top_chord)
path_mapper_3 = PathMapper(shifted_point_list_bottom_chord_2, source="{A;B}(i)", target="{i;B}(A)")
path_mapper_4 = PathMapper(shifted_point_list_top_chord_2, source="{A;B}(i)", target="{i;B}(A)")
shift_4 = ShiftList(List=path_mapper_4, Shift=1, Wrap=Toggle(False))
short_4 = ShortestList(ListA=path_mapper_3, ListB=shift_4, TrimMode=2)  # -> ListA, ListB
ln_2 = Line(StartPoint=short_4.ListA, EndPoint=short_4.ListB)
secondary_truss_bracing = Curve(ln_2)

# ----
# Draw Bracing for Primary Trusses
shifted_point_list_bottom_chord_3 = Point(shifted_point_list_bottom_chord)
shifted_point_list_top_chord_3 = Point(shifted_point_list_top_chord)
path_mapper_5 = PathMapper(shifted_point_list_bottom_chord_3, source="{A;B}(i)", target="{A;i}(B)")
path_mapper_6 = PathMapper(shifted_point_list_top_chord_3, source="{A;B}(i)", target="{A;i}(B)")
shift_5 = ShiftList(List=path_mapper_6, Shift=1, Wrap=Toggle(False))
short_5 = ShortestList(ListA=path_mapper_5, ListB=shift_5, TrimMode=2)  # -> ListA, ListB
ln_3 = Line(StartPoint=short_5.ListA, EndPoint=short_5.ListB)
primary_truss_bracing = Curve(ln_3)

# ----
# End Points of Primary Truss Chords
point_grid_5 = Point(simplify(point_grid))
pline_4 = PolyLine(Vertices=point_grid_5, Closed=False)
end_points = EndPoints(Curve=pline_4)  # -> Start, End
bottom_support_points = Point(end_points.End)
top_support_points = Point(end_points.Start)

top_support_points_2 = ClusterOutput(top_support_points)
bottom_support_points_2 = ClusterOutput(bottom_support_points)
primary_truss_verticals_2 = ClusterOutput(primary_truss_verticals)
plan_bracing_2 = ClusterOutput(plan_bracing)
primary_truss_chords_2 = ClusterOutput(primary_truss_chords)
secondary_truss_chords_2 = ClusterOutput(secondary_truss_chords)
secondary_truss_bracing_2 = ClusterOutput(secondary_truss_bracing)
primary_truss_bracing_2 = ClusterOutput(primary_truss_bracing)
