# Grasshopper definition Speckle-Toolkit_PR1-Dimitrie-dev-SpeckleTest01.gh (Grasshopper 1.0.7)
# plug-ins: UserDataUtils, BH.UI.Grasshopper

pop3d = Populate3D(Region={Plane=PlaneXY(0, 0, 0), X=Domain(0, 10), Y=Domain(0, 10), Z=Domain(0, 2)}, Count=100, Seed=1)
bbox = BoundingBox(Content=pop3d, Plane=PlaneXY(0, 0, 0), UnionBox=True)  # -> Box, Box_2
smesh = SimpleMesh(Brep=bbox.Box)
demesh = DeconstructMesh(Mesh=smesh)  # -> Vertices, Faces, Colours, Normals
anonymous_stream = DataSender(manualmode=False, remotecontroller=False)  # -> Log, StreamId
speckle_hestia = Accounts()
mesh = Mesh(Vertices=demesh.Vertices, Faces=demesh.Faces, Component="{ .Mesh")
speckleadapter = SpeckleAdapter(SpeckleAccount=speckle_hestia, StreamId=anonymous_stream.StreamId, Component="{ ..ctor")
data = Data(mesh)
push = Push(Adapter=speckleadapter, Objects=flatten(data), Active=Toggle(True), Component="{ .Push")  # -> Objects, Success
panel = Panel(push.Objects)
pull = Pull(Adapter=speckleadapter, Active=push.Success, Component="{ .Pull")
explode = Explode(Object=pull, Component="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")  # -> Vertices, Faces
conmesh = ConstructMesh(Vertices=explode.Vertices, Faces=explode.Faces)
panel_2 = Panel(conmesh)
