# Grasshopper definition Speckle-Toolkit_PR1-Dimitrie-dev-SpeckleTest02-history.gh (Grasshopper 1.0.7)
# plug-ins: UserDataUtils, BH.UI.Grasshopper

number_slider = Slider(50, range=0..100)
geo = Geometry(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)
pop3d = Populate3D(Region={Plane=PlaneXY(0, 0, 0), X=Domain(0, 10), Y=Domain(0, 10), Z=Domain(0, 2)}, Count=100, Seed=1)
line = Line(geo)
sph = Sphere(Base=PlaneXY(0, 0, 0), Radius=Slider(50, range=0..100))
bbox = BoundingBox(Content=pop3d, Plane=PlaneXY(0, 0, 0), UnionBox=True)  # -> Box, Box_2
sph_2 = Sphere(Base=PlaneXY(0, 0, 0), Radius=number_slider)
Z = UnitZ(Factor=number_slider)
smesh = SimpleMesh(Brep=bbox.Box)
move = Move(Geometry=sph_2, Motion=Z)  # -> Geometry, Transform
bar = Bar(
    Line=line,
    OrientationAngle=0,
    FeaType="{ \"_t\" : \"System.Enum\", \"TypeName\" : { \"_t\" : \"System.Type\", \"Name\" : \"BH.oM.Structure.Elements.BarFEAType\" }, \"Value\" : \"Flexural\" }",
    Component="{ .Bar")
bar_2 = Bar(
    Line=line,
    OrientationAngle=0,
    FeaType="{ \"_t\" : \"System.Enum\", \"TypeName\" : { \"_t\" : \"System.Type\", \"Name\" : \"BH.oM.Structure.Elements.BarFEAType\" }, \"Value\" : \"Flexural\" }",
    Component="{ .Bar")
demesh = DeconstructMesh(Mesh=smesh)  # -> Vertices, Faces, Colours, Normals
anonymous_stream = DataSender(A=sph, manualmode=False, remotecontroller=False)  # -> Log, StreamId
speckle_hestia = Accounts()
mesh = Mesh(Vertices=demesh.Vertices, Faces=demesh.Faces, Component="{ .Mesh")
anonymous_stream_2 = DataSender(A=move.Geometry, manualmode=False, remotecontroller=False)  # -> Log, StreamId
speckleadapter = SpeckleAdapter(SpeckleAccount=speckle_hestia, StreamId=anonymous_stream.StreamId, Component="{ ..ctor")
# CASE 2
# Out of 3 nodes we build 2 lines.
# Node 3
# Node 2
# Node 1
pt = Point([Point(32.18820436, -15.06376934, 0), Point(32.18820436, 16.01025836, 0), Point(3.244254247, 16.01025836, 0)])
data = Data([bar_2, bar])
data_2 = Data([mesh, data, sph])
node = Node(Coordinates=pt, Component="{ .Node")
item = ListItem(List=node, Index=0, Wrap=True)  # -> Item, Item1, Item2

createtype = CreateType(Component="{ \"_t\" : \"System.Type\", \"Name\" : \"System.Object, mscorlib, Version=4.0.0.0, Culture=neutral, PublicKeyToken=b77a5c561934e089\" }")
createtype_2 = CreateType(Component="{ \"_t\" : \"System.Type\", \"Name\" : \"System.String, mscorlib, Version=4.0.0.0, Culture=neutral, PublicKeyToken=b77a5c561934e089\" }")
createdictionary = CreateDictionary(Keys="EnableHistory", Values=Toggle(False), KeyType=createtype_2, ValueType=createtype, Component="{ .CreateDictionary")

push = Push(Adapter=speckleadapter, Objects=flatten(data_2), Config=createdictionary, Active=Toggle(True), Component="{ .Push")  # -> Objects, Success
bar_3 = Bar(
    StartNode=item.Item,
    EndNode=item.Item1,
    OrientationAngle=0,
    FeaType="{ \"_t\" : \"System.Enum\", \"TypeName\" : { \"_t\" : \"System.Type\", \"Name\" : \"BH.oM.Structure.Elements.BarFEAType\" }, \"Value\" : \"Flexural\" }",
    Component="{ .Bar")
bar_4 = Bar(
    StartNode=item.Item,
    EndNode=item.Item2,
    OrientationAngle=0,
    FeaType="{ \"_t\" : \"System.Enum\", \"TypeName\" : { \"_t\" : \"System.Type\", \"Name\" : \"BH.oM.Structure.Elements.BarFEAType\" }, \"Value\" : \"Flexural\" }",
    Component="{ .Bar")
panel = Panel(push.Objects)
pull = Pull(Adapter=speckleadapter, Active=push.Success, Component="{ .Pull")
explode = Explode(Object=pull, Component="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")  # -> Vertices, Faces
panel_2 = Panel(pull)
explode_2 = Explode(Object=bar_3, Component="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")  # -> StartNode, EndNode, SectionProperty, OrientationAngle, Release, FEAType, Support, Offset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
explode_3 = Explode(Object=bar_4, Component="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")  # -> StartNode, EndNode, SectionProperty, OrientationAngle, Release, FEAType, Support, Offset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
conmesh = ConstructMesh(Vertices=explode.Vertices, Faces=explode.Faces)
panel_3 = Panel(conmesh)
explode_4 = Explode(Object=explode_3.EndNode, Component="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")  # -> Position, Orientation, Support, BHoM_Guid, Name, Tags, CustomData
explode_5 = Explode(Object=explode_2.EndNode, Component="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")  # -> Position, Orientation, Support, BHoM_Guid, Name, Tags, CustomData
explode_6 = Explode(Object=explode_3.StartNode, Component="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")  # -> Position, Orientation, Support, BHoM_Guid, Name, Tags, CustomData
explode_7 = Explode(Object=explode_2.StartNode, Component="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")  # -> Position, Orientation, Support, BHoM_Guid, Name, Tags, CustomData
panel_4 = Panel(explode_6.BHoM_Guid)
panel_5 = Panel(explode_7.BHoM_Guid)
panel_6 = Panel(explode_4.BHoM_Guid)
panel_7 = Panel(explode_5.BHoM_Guid)
push_2 = Push(Adapter=speckleadapter, Objects=flatten([bar_3, bar_4]), Active=Toggle(True), Component="{ .Push")  # -> Objects, Success
merge = Merge(Data1=panel_5, Data2=panel_7, Data3=panel_4, Data4=panel_6)
distinct = CSharpScript(x=merge)  # -> A; inputs x: list of String
# ---------- distinct: C# usings ----------
using System.IO;
using System.Linq;
using System.Data;
using System.Drawing;
using System.Reflection;
using System.Windows.Forms;
using System.Xml;
using System.Xml.Linq;
using System.Runtime.InteropServices;

using Rhino.DocObjects;
using Rhino.Collections;
using GH_IO;
using GH_IO.Serialization;
# ---------- distinct: C# ----------
    A = x.Distinct();
# ---------- end distinct ----------
# These 2 lines will have a total
# of 3 distinct corresponding nodes.
panel_8 = Panel(distinct)
item_2 = ListItem(List=push_2.Objects, Index=0, Wrap=True)  # -> Item, Item1
explode_8 = Explode(Object=item_2.Item, Component="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")  # -> StartNode, EndNode, SectionProperty, OrientationAngle, Release, FEAType, Support, Offset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
explode_9 = Explode(Object=item_2.Item1, Component="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")  # -> StartNode, EndNode, SectionProperty, OrientationAngle, Release, FEAType, Support, Offset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
explode_10 = Explode(Object=explode_9.EndNode, Component="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")  # -> Position, Orientation, Support, BHoM_Guid, Name, Tags, CustomData
explode_11 = Explode(Object=explode_8.EndNode, Component="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")  # -> Position, Orientation, Support, BHoM_Guid, Name, Tags, CustomData
explode_12 = Explode(Object=explode_9.StartNode, Component="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")  # -> Position, Orientation, Support, BHoM_Guid, Name, Tags, CustomData
explode_13 = Explode(Object=explode_8.StartNode, Component="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")  # -> Position, Orientation, Support, BHoM_Guid, Name, Tags, CustomData
panel_9 = Panel(explode_12.BHoM_Guid)
panel_10 = Panel(explode_13.BHoM_Guid)
panel_11 = Panel(explode_10.BHoM_Guid)
panel_12 = Panel(explode_11.BHoM_Guid)
merge_2 = Merge(Data1=panel_10, Data2=panel_12, Data3=panel_9, Data4=panel_11)
distinct_2 = CSharpScript(x=merge_2)  # -> A; inputs x: list of String
# ---------- distinct_2: C# ----------
    A = x.Distinct();
# ---------- end distinct_2 ----------
# These 2 lines will have a total
# of 3 distinct corresponding nodes.
panel_13 = Panel(distinct_2)
