# Grasshopper definition Speckle-Toolkit_issue10-implementRead.gh (Grasshopper 1.0.7)
# plug-ins: UserDataUtils, BH.UI.Grasshopper

# ----
# Elements to push
pop3d = Populate3D(Region={Plane=PlaneXY(0, 0, 0), X=Domain(0, 10), Y=Domain(0, 10), Z=Domain(0, 2)}, Count=100, Seed=1)
bbox = BoundingBox(Content=pop3d, Plane=PlaneXY(0, 0, 0), UnionBox=True)  # -> Box, Box_2
smesh = SimpleMesh(Brep=bbox.Box)
demesh = DeconstructMesh(Mesh=smesh)  # -> Vertices, Faces, Colours, Normals
mesh = Mesh(Vertices=demesh.Vertices, Faces=demesh.Faces, Component="{ .Mesh")

geo = Geometry(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)
line = Line(geo)
bar = Bar(
    Line=line,
    OrientationAngle=0,
    FeaType="{ \"_t\" : \"System.Enum\", \"TypeName\" : { \"_t\" : \"System.Type\", \"Name\" : \"BH.oM.Structure.Elements.BarFEAType\" }, \"Value\" : \"Flexural\" }",
    Component="{ .Bar")

sph = Sphere(Base=PlaneXY(0, 0, 0), Radius=Slider(50, range=0..100))

bar_2 = Bar(
    Line=line,
    OrientationAngle=0,
    FeaType="{ \"_t\" : \"System.Enum\", \"TypeName\" : { \"_t\" : \"System.Type\", \"Name\" : \"BH.oM.Structure.Elements.BarFEAType\" }, \"Value\" : \"Flexural\" }",
    Component="{ .Bar")
data = Data([bar, mesh, sph, bar_2])

# ----
# Set up Speckle Adapter
anonymous_stream = DataSender(A=sph, manualmode=False, remotecontroller=False)  # -> Log, StreamId
speckle_hestia = Accounts()
speckleadapter = SpeckleAdapter(SpeckleAccount=speckle_hestia, SpeckleStreamId=anonymous_stream.StreamId, Component="{ ..ctor")

# ----
# Enable/disable history
# (enabled by default)
createtype = CreateType(Component="{ \"_t\" : \"System.Type\", \"Name\" : \"System.Object, mscorlib, Version=4.0.0.0, Culture=neutral, PublicKeyToken=b77a5c561934e089\" }")
createtype_2 = CreateType(Component="{ \"_t\" : \"System.Type\", \"Name\" : \"System.String, mscorlib, Version=4.0.0.0, Culture=neutral, PublicKeyToken=b77a5c561934e089\" }")
createdictionary = CreateDictionary(Keys="EnableHistory", Values=Toggle(False), KeyType=createtype_2, ValueType=createtype, Component="{ .CreateDictionary")

# ----
# Push (upload)
toggle = BooleanToggle(True)
push = Push(Adapter=speckleadapter, Objects=flatten(data), Config=createdictionary, Active=toggle, Component="{ .Push")  # -> Objects, Success
panel = Panel(push.Objects)

item = ListItem(List=flatten(push.Objects), Index=0, Wrap=True)  # -> Item, Item1, Item2, Item3
explode = Explode(Object=item.Item2, Component="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")  # -> StartNode, EndNode, SectionProperty, OrientationAngle, Release, FEAType, Support, Offset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
explode_2 = Explode(Object=item.Item, Component="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")  # -> StartNode, EndNode, SectionProperty, OrientationAngle, Release, FEAType, Support, Offset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

# ----
# Pull (download)
pull = Pull(Adapter=speckleadapter, Active=Toggle(True), Component="{ .Pull")
panel_2 = Panel(pull)

explode_3 = Explode(Object=explode.CustomData, Component="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")  # -> Speckle_StreamId, Speckle_id
explode_4 = Explode(Object=explode_2.CustomData, Component="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")  # -> Speckle_StreamId, Speckle_id
item_2 = ListItem(List=flatten(pull), Index=0, Wrap=True)  # -> Item, Item1, Item2, Item3
item_3 = ListItem(List=item_2.Item, Index=0, Wrap=True)
panel_3 = Panel(explode_3.Speckle_id)
panel_4 = Panel(explode_4.Speckle_id)
explode_5 = Explode(Object=item_3, Component="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")  # -> StartNode, EndNode, SectionProperty, OrientationAngle, Release, FEAType, Support, Offset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

# ----
# Read certain IDs
panel_5 = Panel("ObjectIds")
createtype_3 = CreateType(Component="{ \"_t\" : \"System.Type\", \"Name\" : \"System.Object, mscorlib, Version=4.0.0.0, Culture=neutral, PublicKeyToken=b77a5c561934e089\" }")
createtype_4 = CreateType(Component="{ \"_t\" : \"System.Type\", \"Name\" : \"System.String, mscorlib, Version=4.0.0.0, Culture=neutral, PublicKeyToken=b77a5c561934e089\" }")
createdictionary_2 = CreateDictionary(Keys=panel_5, Values=panel_4, KeyType=createtype_4, ValueType=createtype_3, Component="{ .CreateDictionary")

explode_6 = Explode(Object=explode_5.CustomData, Component="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")  # -> Speckle_StreamId, Speckle_id
createtype_5 = CreateType(Component="{ \"_t\" : \"System.Type\", \"Name\" : \"BH.oM.Base.BHoMObject\" }")
filterquery = FilterQuery(Type=createtype_5, Equalities=createdictionary_2, Component="{ .FilterQuery")
pull_2 = Pull(Adapter=speckleadapter, Query=filterquery, Active=Toggle(True), Component="{ .Pull")
panel_6 = Panel(pull_2)
