# Grasshopper definition Speckle-Toolkit_issue6and7-tidyUpAndHistory.gh (Grasshopper 1.0.7)
# plug-ins: UserDataUtils, BH.UI.Grasshopper

# ----
# Elements to push
pop3d = Populate3D(Region={Plane=PlaneXY(0, 0, 0), X=Domain(0, 10), Y=Domain(0, 10), Z=Domain(0, 2)}, Count=100, Seed=1)
bbox = BoundingBox(Content=pop3d, Plane=PlaneXY(0, 0, 0), UnionBox=True)  # -> Box, Box_2
smesh = SimpleMesh(Brep=bbox.Box)
demesh = DeconstructMesh(Mesh=smesh)  # -> Vertices, Faces, Colours, Normals
mesh = Mesh(Vertices=demesh.Vertices, Faces=demesh.Faces, Component="{ .Mesh")

geo = Geometry(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)
line = Line(geo)
bar = Bar(
    Line=line,
    OrientationAngle=0,
    FeaType="{ \"_t\" : \"System.Enum\", \"TypeName\" : { \"_t\" : \"System.Type\", \"Name\" : \"BH.oM.Structure.Elements.BarFEAType\" }, \"Value\" : \"Flexural\" }",
    Component="{ .Bar")

sph = Sphere(Base=PlaneXY(0, 0, 0), Radius=Slider(50, range=0..100))

data = Data([bar, mesh, sph])

# ----
# Set up Speckle Adapter
anonymous_stream = DataSender(A=sph, manualmode=False, remotecontroller=False)  # -> Log, StreamId
speckle_hestia = Accounts()
speckleadapter = SpeckleAdapter(SpeckleAccount=speckle_hestia, StreamId=anonymous_stream.StreamId, Component="{ ..ctor")

# ----
# Enable/disable history
# (enabled by default)
createtype = CreateType(Component="{ \"_t\" : \"System.Type\", \"Name\" : \"System.Object, mscorlib, Version=4.0.0.0, Culture=neutral, PublicKeyToken=b77a5c561934e089\" }")
createtype_2 = CreateType(Component="{ \"_t\" : \"System.Type\", \"Name\" : \"System.String, mscorlib, Version=4.0.0.0, Culture=neutral, PublicKeyToken=b77a5c561934e089\" }")
createdictionary = CreateDictionary(Keys="EnableHistory", Values=Toggle(False), KeyType=createtype_2, ValueType=createtype, Component="{ .CreateDictionary")

# ----
# Push (upload)
toggle = BooleanToggle(True)
push = Push(Adapter=speckleadapter, Objects=flatten(data), Config=createdictionary, Active=toggle, Component="{ .Push")  # -> Objects, Success
panel = Panel(push.Objects)

# ----
# Pull (download)
pull = Pull(Adapter=speckleadapter, Active=push.Success, Component="{ .Pull")
panel_2 = Panel(pull)
